# Grasshopper definition latent space.gh (Grasshopper 1.0.7)
# plug-ins: SonicMat, GH_CPython

# ----
# 过小：可能导致收敛慢甚至卡住
# 
# 过大：可能导致发散或布局混乱
# 
# 一般建议在 100 ~ 1000 之间尝试
number_slider = Slider(550, range=0..1000)

# ----
# 值越小：更关注局部结构（邻近点之间更紧密）
# 
# 值越大：更关注整体结构（远处点间关系更明显）
# 
# 通常值在 5 ~ 50 之间比较合理
number_slider_2 = Slider(30, range=0..100)

# ----
# 你的设置是 3 → 表示降到 3 维，可以直接用于 3D 空间中摆放图像
# 
# 不动
number_slider_3 = Slider(3, range=2..3)
number_slider_4 = Slider(3, range=2..3)

panel = Panel("增大它，图片间距就更远；减小它，图片更靠近。")

encoder = Encoder(
    num_components_input=number_slider_3,
    n_dim_input=number_slider_4,
    perplexity_input=number_slider_2,
    learning_rate_input=number_slider,
    scale_input=Slider(8, range=0..10))  # -> pts_output, dir_output; inputs num_components_input: list, n_dim_input: list, perplexity_input: list, learning_rate_input: list, scale_input: list
#   port pts_output: indicate your output description here. refers to a new line.
# ---------- encoder: Python ----------
# -*- coding: utf-8 -*- 
"""
Python Script for Grasshopper Latent Space Visualisation
Created on Monday October 2024 01:49:03 
@author: willi 
"""

import os
import numpy as np
import cv2 as cv
from skimage import color
from sklearn.decomposition import PCA
from sklearn import manifold
from glob import glob
import time

# Inputs from Grasshopper:
# Ensure these variables match the inputs connected in Grasshopper
# folder_path = folder_path_input  # Input folder path from the Grasshopper panel
folder_path = r'E:\\BaiduNetdiskWorkspace\\UCL\\comfyUI\\1128\\all_0113'

num_components = num_components_input  # PCA components from number slider
n_dim = n_dim_input                    # t-SNE components (3D visualisation) from slider
perplexity = perplexity_input          # t-SNE perplexity from number slider
learning_rate = learning_rate_input    # t-SNE learning rate from number slider
scale = scale_input                    # Scaling factor for 3D points from slider

# Reading image files
image_files = glob(os.path.join(folder_path, '*.png'))  # Fetch all jpg images
num_imgs = len(image_files)  # Count number of images

# Ensure there are images to process
if num_imgs == 0:
    raise ValueError("No images found in the folder.")

# Process images and prepare the stack for PCA
im_stack = []

for img_path in image_files:
    img = cv.imread(img_path)
    if img is not None:
        # Convert to greyscale
        img_gray = color.rgb2gray(img)
        
        # Resize to 256x256
        new_size = (256, 256)
        img_gray = cv.resize(img_gray, new_size, interpolation=cv.INTER_AREA)
        
        # Flatten the image and append to stack
        im_stack.append(img_gray.flatten())

# Convert the stack to a NumPy array
im_stack = np.array(im_stack)

# Perform PCA for dimensionality reduction
pca = PCA(n_components=num_components)
low_matrix = pca.fit_transform(im_stack)

# t-SNE for further reduction to 3D coordinates
tsne = manifold.TSNE(n_components=n_dim, init='pca', random_state=0, perplexity=perplexity, learning_rate=learning_rate)
X_tsne = tsne.fit_transform(low_matrix)  # Apply t-SNE on PCA-reduced data
X_tsne = X_tsne * scale  # Optionally scale the coordinates

# Output: 3D coordinates for each image (to be visualised in Grasshopper)
output_points = X_tsne.tolist()  # Convert NumPy array to list for GH output

# Pass the 3D coordinates to Grasshopper for visualisation as points
pts_output = output_points

# Optionally, print the result
for i, pt in enumerate(pts_output):
    print("Image {} 3D coordinates: {}".format(i+1, pt))

#-------------------------------

# List out all the contents in the folder (no need to modify)
dir_files = os.listdir(folder_path)

dir_output = []
for file in dir_files:
    dir_output.append(os.path.join(folder_path, file))

print(dir_output)
# ---------- end encoder ----------
panel_2 = Panel(encoder.dir_output)
panel_3 = Panel(encoder.pts_output)
text_split = TextSplit(Text=panel_2, Separators="'")  # -> simplify(Result)
panel_4 = Panel(text_split)
partition_list = PartitionList(List=panel_3, Size=number_slider_4)
list_item = ListItem(List=panel_4, Index="1", Wrap=True)  # -> flatten(Item)
list_item_2 = ListItem(List=partition_list, Index=2, Wrap=True)
list_item_3 = ListItem(List=partition_list, Index=0, Wrap=True)
list_item_4 = ListItem(List=partition_list, Index=1, Wrap=True)
panel_5 = Panel(list_item)
construct_point = ConstructPoint(XCoordinate=list_item_3, YCoordinate=list_item_4, ZCoordinate=list_item_2)
panel_6 = Panel(construct_point)

series = Series(Start="50", Step="1", Count="50")
panel_7 = Panel(series)
list_item_5 = ListItem(List=flatten(construct_point), Index=series, Wrap=Toggle(False))
line = Line(StartPoint=panel_6, EndPoint=list_item_5)
custom_preview = CustomPreview(Geometry=list_item_5, Material=ColourSwatch(SwatchColor=RGB(0, 238, 255)))
custom_preview_2 = CustomPreview(Geometry=line, Material=ColourSwatch(SwatchColor=RGB(50, 144, 150)))

shift_list = ShiftList(List=construct_point, Shift=1, Wrap=True)
distance = Distance(PointA=flatten(construct_point), PointB=shift_list)  # -> flatten(Distance)
panel_8 = Panel(distance)
smaller_than = SmallerThan(FirstNumber=distance, SecondNumber=Slider(273.753, range=100..2000))  # -> SmallerThan, OrEqualTo
line_2 = Line(StartPoint=flatten(construct_point), EndPoint=shift_list)  # -> flatten(Line)

scale = Slider(58, range=0..100)
center_box = CenterBox(Base=construct_point, X=scale, Y=scale, Z=0)
material = Material(Surface=flatten(center_box), String=panel_5, Double=Slider(0, range=0..100))

cull_pattern = CullPattern(List=line_2, CullPattern=smaller_than.SmallerThan)
custom_preview_3 = CustomPreview(Geometry=cull_pattern, Material=ColourSwatch(SwatchColor=RGB(57, 77, 227)))

# ---- group: line
panel_9 = Panel(line_2)
list_item_6 = ListItem(List=line_2, Index=Slider(36, range=0..200), Wrap=True)
custom_preview_4 = CustomPreview(Geometry=list_item_6, Material=ColourSwatch(SwatchColor=RGB(255, 0, 0)))

# ---- group: point
number_slider_5 = Slider(1, range=0..1)
end = EndPoints(Curve=list_item_6)  # -> Start, End
pdecon = Deconstruct(Point=end.Start)  # -> XComponent, YComponent, ZComponent
pdecon_2 = Deconstruct(Point=end.End)  # -> XComponent, YComponent, ZComponent
eval = Evaluate(F="x + (y-x)*z", x=pdecon.XComponent, y=pdecon_2.XComponent, z=number_slider_5)
eval_2 = Evaluate(F="x + (y-x)*z", x=pdecon.YComponent, y=pdecon_2.YComponent, z=number_slider_5)
eval_3 = Evaluate(F="x + (y-x)*z", x=pdecon.ZComponent, y=pdecon_2.ZComponent, z=number_slider_5)
panel_10 = Panel(eval)
panel_11 = Panel(eval_2)
panel_12 = Panel(eval_3)
pt = ConstructPoint(XCoordinate=panel_10, YCoordinate=panel_11, ZCoordinate=panel_12)
